# Grasshopper definition ashley_is_amazing.gh (Grasshopper 1.0.7)

number_slider = Slider(32.55, range=0..100)
series = Series(Start=0, Step=Slider(3, range=0..100), Count=number_slider)
curve = Curve(<curve referenced from the Rhino model>)
curve_2 = Curve([<curve referenced from the Rhino model> x4])
unit_z = UnitZ(Factor=series)
curve_3 = Curve(<curve referenced from the Rhino model>)
curve_4 = Curve(<curve referenced from the Rhino model>)
area = Area(Geometry=curve)  # -> Area, Centroid
flip_curve = FlipCurve(Curve=curve_3)  # -> Curve, Flag
move = Move(Geometry=curve, Motion=unit_z)  # -> Geometry, Transform
rotate = Rotate(Geometry=flip_curve.Curve, Angle=Slider(0, range=0..1), Plane=PlaneXY(0, 0, 0))  # -> Geometry, Transform
series_2 = Series(Start=1, Step=Slider(9, range=0..100), Count=number_slider)
scale = Scale(Geometry=move.Geometry, Center=area.Centroid, Factor=series_2)  # -> Geometry, Transform
panel = Panel(series_2)
loft = Loft(Options={Adjust=False, Closed=False, LoftEnds=0, LoftSimp=0, LoftType=0, Rebuild=10, Refit=0.01})
