# Grasshopper definition basic_surfaces_meshes.gh (Grasshopper 1.0.7)

pt = Point(<point referenced from the Rhino model>)
pt_2 = Point(<point referenced from the Rhino model>)
pt_3 = Point(<point referenced from the Rhino model>)
pt_4 = Point(<point referenced from the Rhino model>)
crv = Curve([<curve referenced from the Rhino model> x4])
crv_2 = Curve(<curve referenced from the Rhino model>)
rec = Rectangle({Plane=PlaneXY(36.14914926, 33.77727614, 0), Size=Domain2(u=-9.143053306..9.143053306, v=-8.264681373..8.264681373)})
crv_3 = Curve([<curve referenced from the Rhino model> x3])
revsrf = Revolution(Curve=crv_2, Axis=Line((24.90122088, 0, 0.01893737863), (24.90122088, 0, 17.96962912)), Domain=Domain(0, 6.283185307))
mplane = MeshPlane(Boundary=rec, WidthCount=10, HeightCount=10)  # -> Mesh, Area
loft = Loft(Curves=crv_3, Options={Adjust=False, Closed=False, LoftEnds=0, LoftSimp=0, LoftType=0, Rebuild=10, Refit=0.01})
conmesh = ConstructMesh(Vertices=[Point(0, 0, 0), Point(10, 0, 0), Point(10, 10, 0), Point(0, 10, 0)], Faces={A=0, B=1, C=2, D=3})
srf4pt = _4PointSurface(CornerA=pt, CornerB=pt_2, CornerC=pt_4, CornerD=pt_3)
boundary = BoundarySurfaces(Edges=crv)
