# Grasshopper definition harkonnen.gh (Grasshopper 1.0.7)

gene_pool = GenePool(Decimals=2, Maximum=500, Minimum=20, Value=[164.8, 496.18, 259.86, 63.83, 92.93, 161.98, 279.6])
unit_z = UnitZ(Factor=Slider(0.6, range=0..3))
xy_plane = XYPlane(Origin=Point(0, 0, 0))
linear_array = LinearArray(Geometry=xy_plane, Direction=unit_z, Count=Slider(100, range=0..100))  # -> Geometry, Transform
points = Points([Point(87.78377112, 120.1560546, 0), Point(29.82415601, 113.4346684, 0), Point(55.22699176, 36.76965095, 0), Point(106.0866268, 74.57107236, 0), Point(155.4584493, 58.04064721, 0), Point(160.7355285, 104.6973767, 0), Point(139.3378648, 142.6627464, 0)])
metaball_t_custom = MetaBallTCustom(Points=points, Charge=gene_pool, Plane=linear_array.Geometry, Threshold=0.5)
unit_z_2 = UnitZ(Factor=1)
surface = Surface(metaball_t_custom)
cylinder = Cylinder(Base=xy_plane, Radius=Slider(23, range=0..100), Length=Slider(27, range=0..100))
extrude = Extrude(Base=cylinder, Direction=unit_z_2)
