# Grasshopper definition lamp (1).gh (Grasshopper 1.0.7)
# plug-ins: Pufferfish

sz = Slider(90.697, range=0..100)
crv = Curve(<curve referenced from the Rhino model>)
python = GhPythonScript(
    u0=Slider(6.288, range=-4..12),
    u1=Slider(0, range=-4..4),
    v0=Slider(1.81396, range=-4..4),
    v1=Slider(3.021, range=-4..4),
    nv=Slider(7, range=0..150),
    nu=Slider(149, range=0..150),
    sx=Slider(80, range=0..100),
    sy=Slider(80, range=0..100),
    sz=sz)  # -> out, a, b, c; inputs nv: Int32, nu: Int32
# ---------- python: Python ----------
__author__ = "jenniferjacobs"

import rhinoscriptsyntax as rs
import Rhino.Geometry as geom
import math


def paramsurfA(u, v):
    x = math.cos(u) * math.cos(v)*sx
    y = math.sin(u) * math.cos(v)*sy
    z = math.sin(v)*sz
    return geom.Point3d(x, y, z)

def paramsurfB(u, v):
    x = math.cos(u)*sx
    y = math.sin(u)*sy
    z = v*sz
    return geom.Point3d(x, y, z)

def paramsurfC(u, v):
    
    r =(1+0.1*math.cos(20*u))
    x = math.cos(u) * math.cos(v)*sx*r
    y = math.sin(u) * math.cos(v)*sy*r
    z = math.sin(v)*sz
    return geom.Point3d(x, y, z)

def paramsurfD(u, v, j):
    r= 1
    if(j>0):
        r =(1+0.1*math.cos(20*u))

    x = math.cos(u) * math.cos(v)*sx*r
    y = math.sin(u) * math.cos(v)*sy*r
    z = math.sin(v)*sz*r
    return geom.Point3d(x, y, z)
u = u0
du = (u1 - u0) / float(nu)
v = v0
dv = (v1 - v0) / float(nv)
i = 0
j = 0
k = 0

ms = geom.Mesh.CreateFromPlane(geom.Plane.WorldXY, geom.Interval(u0, u1), geom.Interval(v0, v1), nu, nv)
v = v0
for j in range(0,nv+1):
   
    u = u0
    for i in range(0,nu+1):
        ms.Vertices.SetVertex(k, paramsurfD(u, v, j))
        u = u+du
        k = k+1
    v = v+dv

ms.FaceNormals.ComputeFaceNormals();
ms.Normals.ComputeNormals();
a = ms;

plu =[]
plv = []
v = v0
j=0
i=0
for j in range(0,nv+1):
    r= 1
    if(j>0):
        r =(1+0.1*math.cos(20*u))
    u = u0
    pl = geom.Polyline()
    for i in range(0,nu+1):
        pl.Add(paramsurfD(u, v, j))
        u += du
    v += dv
    plu.Add(pl)

u = u0;
j=0
i=0
for i in range(0,nu+1):
    v = v0
    pl = geom.Polyline()
    for j in range(0,nv+1):
        pl.Add(paramsurfD(u, v,j))
        v = v+dv;
    u = u+du
    plv.Add(pl)

b = plu
c = plv
# ---------- end python ----------
revsrf = Revolution(Curve=crv, Axis=Line((0, 0, 100), (0, 0, 74)), Domain=Domain(0, 6.283185307))
mesh = Mesh(python.a)
crv_2 = Curve(python.b)
offmsh = OffsetMesh(Mesh=python.a, Distance=1.5, BothSides=False, CreateSolid=True)
panel = Panel(python.out)
split = SplitList(List=crv_2, Index=1)  # -> ListA, ListB
crv_3 = Curve(split.ListA)
crv_4 = Curve(split.ListB)
msh2psrf = MeshToPolysurface(Mesh=offmsh, Triangles=False, FaceMerge=False)
cap = CapHoles(Brep=revsrf)
