# Grasshopper definition lamp-attempt.gh (Grasshopper 1.0.7)

crv = Curve(<curve referenced from the Rhino model>)
crv_2 = Curve(<curve referenced from the Rhino model>)
panel = Panel("220")
panel_3 = Panel("250")
panel_4 = Panel("210")
crv_3 = Curve(<curve referenced from the Rhino model>)
crv_4 = Curve([<curve referenced from the Rhino model> x3])
loft = Loft(Curves=crv_4, Options={Adjust=False, Closed=False, LoftEnds=0, LoftSimp=0, LoftType=0, Rebuild=10, Refit=0.01})
boundary = BoundarySurfaces(Edges=crv_3)
