# Grasshopper definition last-go-maybe.gh (Grasshopper 1.0.7)

curve = Curve([<curve referenced from the Rhino model> x2])
unit_z = UnitZ(Factor=Slider(-17, range=-50..100))
loft = Loft(Curves=curve, Options={Adjust=False, Closed=False, LoftEnds=0, LoftSimp=0, LoftType=0, Rebuild=10, Refit=0.01})
start = Start(Point(0.08790269543, -0.004273355544, 0))
move = Move(Motion=unit_z)  # -> Geometry, Transform
line_sdl = LineSDL(Start=start, Direction=Vector(0, 0, 1), Length=Slider(15, range=2..25))
divide_curve = DivideCurve(Curve=reparameterize(line_sdl), Count=Slider(11, range=3..30), Kinks=False)  # -> Points, Tangents, Parameters
graph_mapper = GraphMapper(
    divide_curve.Parameters,
    x0=0,
    x1=1,
    y0=0,
    y1=1,
    container_name="Gaussian",
    factor=0.2,
    mean=0.4770642221,
    sdev=0.284403652)
multiplication = Multiplication(A=graph_mapper, B=Slider(20, range=1..20))
circle = Circle(Plane=divide_curve.Points, Radius=multiplication)
loft_2 = Loft(Curves=circle, Options={Adjust=False, Closed=False, LoftEnds=0, LoftSimp=0, LoftType=0, Rebuild=10, Refit=0.01})
