# Grasshopper definition organic-vase.gh (Grasshopper 1.0.7)
# plug-ins: Kangaroo2 Components

number_slider = Slider(200, range=0..500)
_7 = Slider(8.3, range=2..10)
xy = XYPlane(Origin=Point(0, 0, 0))
division = Division(A=number_slider, B=_7)
division_2 = Division(A=number_slider, B=Slider(2.8, range=2..10))
planesrf = PlaneSurface(Plane=xy, XSize=Slider(200, range=0..500), YSize=number_slider)
dom = ConstructDomain(DomainStart=division, DomainEnd=division_2)
pcen = PolygonCenter(Polyline=planesrf)  # -> CenterV, CenterE, CenterA
range = Range(Domain=dom, Steps=Slider(2, range=0..10))
cir = Circle(Plane=pcen.CenterV, Radius=range)
len = Length(Curve=cir)
division_3 = Division(A=len, B=Slider(1, range=0..10))
divide = DivideCurve(Curve=cir, Count=division_3, Kinks=False)  # -> simplify(Points), Tangents, Parameters
pline = PolyLine(Vertices=divide.Points, Closed=invert(False))
lng = ListLength(List=divide.Points)  # -> flatten(Length)
explode = Explode(Curve=pline, Recursive=True)  # -> Segments, Vertices
series = Series(Start=0, Step=1, Count=lng)
pt = Point(flatten(divide.Points))
line = Line(flatten(explode.Segments))
shift = ShiftList(List=series, Shift=1, Wrap=True)
shift_2 = ShiftList(List=explode.Segments, Shift=1, Wrap=True)
entwine = Entwine(Branch00=line, Branch01=pt, FlattenInputs=True)
int = Integer(flatten(shift))
int_2 = Integer(flatten(series))
angle = Angle(LineA=explode.Segments, LineB=shift_2, RestAngle="0", Strength=Slider(1000, range=0..1000))
onmesh = OnMesh(Points=divide.Points, Mesh=planesrf, Strength=Slider(1000, range=0..1000))
length_line = LengthLine(Line=flatten(explode.Segments), Length=Slider(6.266, range=0..10), Strength=Slider(10, range=0..10))
collider = Collider(Objects=entwine, Radii=Slider(1.19, range=0..5), IgnoreA=int_2, IgnoreB=int, Strength=Slider(593, range=0..1000))
show = Show(G=pline)
merge = Merge(Data1=onmesh, Data2=length_line, Data3=angle, Data4=collider)
toggle = BooleanToggle(False)
entwine_2 = Entwine(Branch00=show, Branch01=merge, FlattenInputs=True)
solver = Solver(GoalObjects=entwine_2, Reset=Button(), Threshold=1e-15, Tolerance=0.0001, On=True)  # -> I, V, simplify(O)
bang = ExplodeTree(Data=solver.O)  # -> Branch0, Branch1
crv = Curve(bang.Branch0)
disc = Discontinuity(Curve=crv, Level=1)  # -> Points, Parameters
nurbs = NurbsCurve(Vertices=disc.Points, Degree=3, Periodic=invert(False))  # -> Curve, Length, Domain
offset = OffsetCurve(Curve=planesrf, Distance=Slider(5, range=0..10), Corners=1)
