# Grasshopper definition surface1.gh (Grasshopper 1.0.7)

number_slider = Slider(4, range=-4..4)
number_slider_2 = Slider(-3.048, range=-4..4)
number_slider_3 = Slider(40, range=0..150)
number_slider_4 = Slider(-4, range=-4..4)
number_slider_5 = Slider(4, range=-4..4)
number_slider_6 = Slider(80, range=0..150)
# Linear Surface Function
python = GhPythonScript(x0=number_slider_2, x1=number_slider_5, y0=number_slider_4, y1=number_slider, nx=number_slider_6, ny=number_slider_3)  # -> out, a, b, c; inputs nx: Int32, ny: Int32
# ---------- python: Python ----------
__author__ = "jenniferjacobs"

import rhinoscriptsyntax as rs
import Rhino.Geometry as geom
import math
x = x0
dx = (x1-x0)/float(nx)

y = y0
dy = (y1-y0)/float(ny)

z = 0.0

i=0
j=0
k=0
d = 1

ms = geom.Mesh.CreateFromPlane(geom.Plane.WorldXY, geom.Interval(x0,x1), geom.Interval(y0,y1),nx,ny)

for j in range(0,ny+1):
    x = x0
    for i in range(0,nx+1):
        z = d*x
        ms.Vertices.SetVertex(k,x,y,z) 
        x = x+dx
        k = k+1
    y = y+dy

'''Compute normals of mesh'''    
ms.FaceNormals.ComputeFaceNormals()
ms.Normals.ComputeNormals()

a = ms


plx = []
ply = []

y = y0
i=0
j=0

for j in range(0,ny+1):
    x = x0
    p1 = geom.Polyline()
    for i in range(0,nx+1):
        z = d*x
        p = geom.Point3d(x,y,z)
        p1.Add(p)
        x = x+dx
    y = y+dy
    plx.append(p1)
b = plx

i=0
j=0
x = x0
for i in range(0,nx+1):
    y = y0
    p1 = geom.Polyline()
    for j in range(0,ny+1):
        z = d*x
        p = geom.Point3d(x,y,z)
        p1.Add(p)
        y = y+dy
    x = x+dx
    ply.append(p1)
    
c = ply
# ---------- end python ----------
# Parabolic Surface Function
python_2 = GhPythonScript(x0=number_slider_2, x1=number_slider_5, y0=number_slider_4, y1=number_slider, nx=number_slider_6, ny=number_slider_3)  # -> out, a, b, c; inputs nx: Int32, ny: Int32
# ---------- python_2: Python ----------
__author__ = "jenniferjacobs"

import rhinoscriptsyntax as rs
import Rhino.Geometry as geom
import math
x = x0
dx = (x1-x0)/float(nx)

y = y0
dy = (y1-y0)/float(ny)

z = 0.0

i=0
j=0
k=0
a = 1.0

ms = geom.Mesh.CreateFromPlane(geom.Plane.WorldXY, geom.Interval(x0,x1), geom.Interval(y0,y1),nx,ny)

for j in range(0,ny+1):
    x = x0
    for i in range(0,nx+1):
        z = (-math.pow(x,2)- math.pow(y,2))*0.25
        ms.Vertices.SetVertex(k,x,y,z) 
        x = x+dx
        k = k+1
    y = y+dy

'''Compute normals of mesh'''    
ms.FaceNormals.ComputeFaceNormals()
ms.Normals.ComputeNormals()

a = ms


plx = []
ply = []

y = y0
i=0
j=0

for j in range(0,ny+1):
    x = x0
    p1 = geom.Polyline()
    for i in range(0,nx+1):
        z = (-math.pow(x,2)- math.pow(y,2))*0.25
        p = geom.Point3d(x,y,z)
        p1.Add(p)
        x = x+dx
    y = y+dy
    plx.append(p1)
b = plx

i=0
j=0
x = x0
for i in range(0,nx+1):
    y = y0
    p1 = geom.Polyline()
    for j in range(0,ny+1):
        z = (-math.pow(x,2)- math.pow(y,2))*0.25
        p = geom.Point3d(x,y,z)
        p1.Add(p)
        y = y+dy
    x = x+dx
    ply.append(p1)
    
c = ply
# ---------- end python_2 ----------
# Trigonometric Surface Function
python_3 = GhPythonScript(x0=number_slider_2, x1=number_slider_5, y0=number_slider_4, y1=number_slider, nx=number_slider_6, ny=number_slider_3)  # -> out, a, b, c; inputs nx: Int32, ny: Int32
# ---------- python_3: Python ----------
__author__ = "jenniferjacobs"

import rhinoscriptsyntax as rs
import Rhino.Geometry as geom
import math
x = x0
dx = (x1-x0)/float(nx)

y = y0
dy = (y1-y0)/float(ny)

z = 0.0

i=0
j=0
k=0

ms = geom.Mesh.CreateFromPlane(geom.Plane.WorldXY, geom.Interval(x0,x1), geom.Interval(y0,y1),nx,ny)

for j in range(0,ny+1):
    x = x0
    for i in range(0,nx+1):
        z = math.cos(x)*math.sin(y)
        ms.Vertices.SetVertex(k,x,y,z) 
        x = x+dx
        k = k+1
    y = y+dy

'''Compute normals of mesh'''    
ms.FaceNormals.ComputeFaceNormals()
ms.Normals.ComputeNormals()

a = ms


plx = []
ply = []

y = y0
i=0
j=0

for j in range(0,ny+1):
    x = x0
    p1 = geom.Polyline()
    for i in range(0,nx+1):
        z = math.cos(x)*math.sin(y)
        p = geom.Point3d(x,y,z)
        p1.Add(p)
        x = x+dx
    y = y+dy
    plx.append(p1)
b = plx

i=0
j=0
x = x0
for i in range(0,nx+1):
    y = y0
    p1 = geom.Polyline()
    for j in range(0,ny+1):
        z = math.cos(x)*math.sin(y)
        p = geom.Point3d(x,y,z)
        p1.Add(p)
        y = y+dy
    x = x+dx
    ply.append(p1)
    
c = ply
# ---------- end python_3 ----------
panel = Panel(python.out)
panel_2 = Panel(python_2.out)
panel_3 = Panel(python_3.out)
