# Grasshopper definition surface2.gh (Grasshopper 1.0.7)

sz = Slider(58.695, range=0..100)
python = GhPythonScript(
    u0=Slider(2.3, range=-4..4),
    u1=Slider(-4, range=-4..4),
    v0=Slider(1.207, range=-4..4),
    v1=Slider(-1.388, range=-4..4),
    nv=Slider(10, range=0..150),
    nu=Slider(74, range=0..150),
    sx=Slider(56.305, range=0..100),
    sy=Slider(65.777, range=0..100),
    sz=sz)  # -> out, a, b, c; inputs nv: Int32, nu: Int32
# ---------- python: Python ----------
__author__ = "jenniferjacobs"

import rhinoscriptsyntax as rs
import Rhino.Geometry as geom
import math


def paramsurfA(u, v):
    x = math.cos(u) * math.cos(v)*sx
    y = math.sin(u) * math.cos(v)*sy
    z = math.sin(v)*sz
    return geom.Point3d(x, y, z)

def paramsurfB(u, v):
    r =(1+0.1*math.cos(10*u))
    x = math.cos(u)*sx
    y = math.sin(u)*sy
    z = v*sz
    return geom.Point3d(x, y, z)

def paramsurfC(u, v):
    r =(1+0.1*math.cos(10*u))
    x = math.cos(u) * math.cos(v)*r*sx
    y = math.sin(u) * math.cos(v)*r*sy
    z = math.sin(v)*r*sz
    return geom.Point3d(x, y, z)


u = u0
du = (u1 - u0) / float(nu)
v = v0
dv = (v1 - v0) / float(nv)
i = 0
j = 0
k = 0

ms = geom.Mesh.CreateFromPlane(geom.Plane.WorldXY, geom.Interval(u0, u1), geom.Interval(v0, v1), nu, nv)
v = v0
for j in range(0,nv+1):
    
    u = u0
    for i in range(0,nu+1):
        ms.Vertices.SetVertex(k, paramsurfC(u, v))
        u = u+du
        k = k+1
    v = v+dv

ms.FaceNormals.ComputeFaceNormals();
ms.Normals.ComputeNormals();
a = ms;

plu =[]
plv = []
v = v0
j=0
i=0
for j in range(0,nv+1):
    u = u0
    pl = geom.Polyline()
    for i in range(0,nu+1):
        pl.Add(paramsurfC(u, v))
        u += du
    v += dv
    plu.Add(pl)

u = u0;
j=0
i=0
for i in range(0,nu+1):
    v = v0
    pl = geom.Polyline()
    for j in range(0,nv+1):
        pl.Add(paramsurfC(u, v))
        v = v+dv;
    u = u+du
    plv.Add(pl)

b = plu
c = plv
# ---------- end python ----------
panel = Panel(python.out)
