# Grasshopper definition koozy.gh (Grasshopper 1.0.7)

brep = Brep(<brep referenced from the Rhino model>)
contour = Contour(Shape=brep, Point="0,0,0", Direction="0,0,1", Distance="0.2")
curve_to_polyline = CurveToPolyline(Curve=contour, ToleranceDistance=0, ToleranceAngle=Slider(27, range=0..100))  # -> Polyline, Segments
explode = Explode(Curve=curve_to_polyline.Polyline, Recursive=True)  # -> Segments, Vertices
control_points = ControlPoints(Curve=curve_to_polyline.Polyline)  # -> Points, Weights, Knots
length = Length(Curve=explode.Segments)
deconstruct = Deconstruct(Point=control_points.Points)  # -> XComponent, YComponent, ZComponent
insert_items = InsertItems(List=length, Item="0", Indices="0", Wrap=True)
concatenate = Concatenate(
    Fragment_A="G1 ",
    Fragment_B="F1800 ",
    A=" X ",
    E=deconstruct.XComponent,
    B=" Y ",
    F=deconstruct.YComponent,
    C=" Z ",
    G=deconstruct.ZComponent,
    D=" E ",
    H=insert_items)  # -> flatten(Result)
panel = Panel("""M104 S{material_print_temperature_layer_0} ; Set Extruder temperature

M140 S{material_bed_temperature_layer_0} ; Set Heat Bed temperature

M190 S{material_bed_temperature_layer_0} ; Wait for Heat Bed temperature

M109 S{material_print_temperature_layer_0} ; Wait for Extruder temperature

G28 ; Home all axes

M117 Purge extruder

G92 E0 ; Reset Extruder

G1 Z2.0 F3000 ; Move Z Axis up little to prevent scratching of Heat Bed

G1 X0.1 Y20 Z0.3 F5000.0 ; Move to start position

G1 X0.1 Y200.0 Z0.3 F1500.0 E15 ; Draw the first line

G1 X0.4 Y200.0 Z0.3 F5000.0 ; Move to side a little

G1 X0.4 Y20 Z0.3 F1500.0 E30 ; Draw the second line

G92 E0 ; Reset Extruder

G1 Z2.0 F3000 ; Move Z Axis up little to prevent scratching of Heat Bed

M117 By your command!""")
panel_2 = Panel("""G4 ; Wait

M220 S100 ; Reset Speed factor override percentage to default (100%)

M221 S100 ; Reset Extrude factor override percentage to default (100%)

G91 ; Set coordinates to relative

G1 F1800 E-3 ; Retract filament 3 mm to prevent oozing

G1 F3000 Z20 ; Move Z Axis up 20 mm to allow filament ooze freely

G90 ; Set coordinates to absolute

G1 X0 Y{machine_depth} F1000 ; Move Heat Bed to the front for easy print removal

M106 S0 ; Turn off cooling fan

M104 S0 ; Turn off extruder

M140 S0 ; Turn off bed

M107 ; Turn off Fan

M84 ; Disable stepper motors

M117 That's All Folks!""")
panel_3 = Panel(concatenate)
merge = Merge(Data1=panel, Data2=panel_3, Data3=panel_2)
panel_4 = Panel(merge)
stream_gate = StreamGate(Gate=panel_4)  # -> Target0, Target1
